# Grasshopper definition definition.ghx (Grasshopper 1.0.8)
# plug-ins: ReBear
# Esempio ReBear; leggere README.md.

dcm = DatabaseConcrete(Type=3)
rs = DatabaseRebarSteel(Type=1, Behaviour=0)
# ReBear — esempio svolto: Sezione circolare e rapporto di omogeneizzazione
# Geometria: mm; forze: kN; momenti: kNm; compressione negativa.
# Dati a sinistra, verifiche e risultati verso destra.
# Dati persistenti nelle porte: tasto destro > Set...
# Consultare README.md e results.json nella stessa cartella.
# Run=True nei componenti di analisi predisposti.
circrc = CircularRCSection(Concrete=dcm, Steel=rs, Diameter=600, LinkCover=40, LinkDiameter=10, BarDiameter=20, BarCount=12, PolygonSides=64)  # -> RCSection, ConcretePreview, Rebars, ConcreteArea, SteelArea, MinimumBarCover
creep_and_homogenization = CreepAndHomogenization(Concrete=dcm, Steel=rs, InputIsN=False, Value=1.5)  # -> CreepCoefficient, ModularRatio, EffectiveConcreteModulus
geomcheck = SectionGeometryCheck(Section=circrc.RCSection, RequiredBarCover=50, RequiredClearSpacing=25, SectionID="S")  # -> Result, MinimumBarCover, MinimumClearSpacing, SteelArea
report = CheckReport(Results=geomcheck.Result)  # -> CSV, JSON, Summary
result = CheckResult(Result=geomcheck.Result)  # -> Section, Case, Check, Status, Utilization, Demand, Capacity, Unit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
csv_risultati = Panel(report.CSV)
