# Grasshopper definition definition.ghx (Grasshopper 1.0.8)
# plug-ins: ReBear
# Esempio ReBear; leggere README.md.

dcm = DatabaseConcrete(Type=3)
rs = DatabaseRebarSteel(Type=1, Behaviour=0)
# ReBear — esempio svolto: Sezione a T con ala superiore
# Geometria: mm; forze: kN; momenti: kNm; compressione negativa.
# Dati a sinistra, verifiche e risultati verso destra.
# Dati persistenti nelle porte: tasto destro > Set...
# Consultare README.md e results.json nella stessa cartella.
# Run=True nei componenti di analisi predisposti.
trc = TRCSection(
    Concrete=dcm,
    Steel=rs,
    FlangeWidth=800,
    Height=700,
    WebWidth=300,
    FlangeThickness=180,
    LinkCover=30,
    LinkDiameter=8,
    BarDiameter=20,
    TopBars=6,
    BottomBars=3,
    WebBarsPerFace=2)  # -> RCSection, ConcretePreview, Rebars, ConcreteArea, SteelArea, MinimumBarCover
geomcheck = SectionGeometryCheck(Section=trc.RCSection, RequiredBarCover=38, RequiredClearSpacing=25, SectionID="S")  # -> Result, MinimumBarCover, MinimumClearSpacing, SteelArea
report = CheckReport(Results=geomcheck.Result)  # -> CSV, JSON, Summary
result = CheckResult(Result=geomcheck.Result)  # -> Section, Case, Check, Status, Utilization, Demand, Capacity, Unit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
csv_risultati = Panel(report.CSV)
