# Grasshopper definition definition.ghx (Grasshopper 1.0.8)
# plug-ins: ReBear
# Esempio ReBear; leggere README.md.

dcm = DatabaseConcrete(Type=3)
rs = DatabaseRebarSteel(Type=1, Behaviour=0)
# ReBear — esempio svolto: Sezione cava con due corone
# Geometria: mm; forze: kN; momenti: kNm; compressione negativa.
# Dati a sinistra, verifiche e risultati verso destra.
# Dati persistenti nelle porte: tasto destro > Set...
# Consultare README.md e results.json nella stessa cartella.
# Run=True nei componenti di analisi predisposti.
boxrc = BoxRCSection(
    Concrete=dcm,
    Steel=rs,
    Width=1000,
    Height=1200,
    HoleWidth=500,
    HoleHeight=700,
    LinkCover=35,
    LinkDiameter=10,
    BarDiameter=20,
    OuterBarsPerHorizontalSide=6,
    OuterBarsPerVerticalSide=8,
    InnerBarsPerHorizontalSide=4,
    InnerBarsPerVerticalSide=6)  # -> RCSection, ConcretePreview, Rebars, ConcreteArea, SteelArea, MinimumBarCover
geomcheck = SectionGeometryCheck(Section=boxrc.RCSection, RequiredBarCover=45, RequiredClearSpacing=25, SectionID="S")  # -> Result, MinimumBarCover, MinimumClearSpacing, SteelArea
report = CheckReport(Results=geomcheck.Result)  # -> CSV, JSON, Summary
result = CheckResult(Result=geomcheck.Result)  # -> Section, Case, Check, Status, Utilization, Demand, Capacity, Unit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
csv_risultati = Panel(report.CSV)
