# Grasshopper definition definition.ghx (Grasshopper 1.0.8)
# plug-ins: ReBear
# Esempio ReBear; leggere README.md.

# ReBear — esempio svolto: Taglio senza staffe: caso valutabile e caso escluso
# Geometria: mm; forze: kN; momenti: kNm; compressione negativa.
# Dati a sinistra, verifiche e risultati verso destra.
# Dati persistenti nelle porte: tasto destro > Set...
# Consultare README.md e results.json nella stessa cartella.
# Run=True nei componenti di analisi predisposti.
dcm = DatabaseConcrete(Type=3)
S = Standard(Type=0)
rs = DatabaseRebarSteel(Type=1, Behaviour=0)
cs = CoordinateSystem(Name="Global XY", Origin=Point(0, 0, 0), P1=Point(1, 0, 0), P2=Point(0, 1, 0))
rectrc = RectangularRCSection(
    Concrete=dcm,
    Steel=rs,
    Width=300,
    Height=500,
    LinkCover=30,
    LinkDiameter=8,
    BarDiameter=20,
    TopBars=4,
    BottomBars=4,
    SideBarsPerFace=0)  # -> RCSection, ConcretePreview, Rebars, ConcreteArea, SteelArea, MinimumBarCover
vopt = ShearOptions(
    LinkSteel=rs,
    LongitudinalSteel=rs,
    WebWidth=300,
    EffectiveDepth=452,
    LongitudinalArea=1256.637061,
    LinkArea=0,
    Spacing=150,
    LinkAngle=90,
    CotTheta=1.5,
    LeverFactor=0.9,
    Aggregate=20,
    AxialEccentricity=0)
cco = ConcreteCheckerOptions(
    CoordinateSystem=cs,
    FailureDomainTypes=1,
    FailureAnalysisTypes=0,
    DomainPointStrategyTypes=0,
    StressAnalysisTypes=1,
    ΨRebar=1.5,
    ΨTendon=0,
    ConsiderTensileConcrete=False,
    ThetaDiscretization=64)
fc = ForceComponent(Name="Compresso", AxialForce=-300, ShearX=0, ShearY=60, Torsion=0, BendingX=45, BendingY=0, CoordinateSystem=cs, Units=1)
fc_2 = ForceComponent(Name="Teso", AxialForce=100, ShearX=0, ShearY=60, Torsion=0, BendingX=45, BendingY=0, CoordinateSystem=cs, Units=1)
cc = ConcreteChecker(ReinforcedConcreteSection=rectrc.RCSection, Standard=S, Options=cco)
batch = BatchSectionChecks(Checker=cc, Forces=[fc, fc_2], SectionID="S", NMxMy=False, ShearY=vopt, Run=True)  # -> Results, CSV, Envelope
report = CheckReport(Results=batch.Results)  # -> CSV, JSON, Summary
result = CheckResult(Result=batch.Results)  # -> Section, Case, Check, Status, Utilization, Demand, Capacity, Unit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
csv_risultati = Panel(report.CSV)
