# Grasshopper definition definition.ghx (Grasshopper 1.0.8)
# plug-ins: ReBear
# Esempio ReBear; leggere README.md.

# ReBear — esempio svolto: Torsione con due tagli concomitanti
# Geometria: mm; forze: kN; momenti: kNm; compressione negativa.
# Dati a sinistra, verifiche e risultati verso destra.
# Dati persistenti nelle porte: tasto destro > Set...
# Consultare README.md e results.json nella stessa cartella.
# Run=True nei componenti di analisi predisposti.
dcm = DatabaseConcrete(Type=3)
S = Standard(Type=0)
rs = DatabaseRebarSteel(Type=1, Behaviour=0)
cs = CoordinateSystem(Name="Global XY", Origin=Point(0, 0, 0), P1=Point(1, 0, 0), P2=Point(0, 1, 0))
rectrc = RectangularRCSection(
    Concrete=dcm,
    Steel=rs,
    Width=300,
    Height=500,
    LinkCover=30,
    LinkDiameter=8,
    BarDiameter=20,
    TopBars=4,
    BottomBars=4,
    SideBarsPerFace=0)  # -> RCSection, ConcretePreview, Rebars, ConcreteArea, SteelArea, MinimumBarCover
vopt = ShearOptions(
    LinkSteel=rs,
    LongitudinalSteel=rs,
    WebWidth=500,
    EffectiveDepth=252,
    LongitudinalArea=628.3185307,
    LinkArea=100.5309649,
    Spacing=150,
    LinkAngle=90,
    CotTheta=1.5,
    LeverFactor=0.9,
    Aggregate=20,
    AxialEccentricity=0)
vopt_2 = ShearOptions(
    LinkSteel=rs,
    LongitudinalSteel=rs,
    WebWidth=300,
    EffectiveDepth=452,
    LongitudinalArea=1256.637061,
    LinkArea=100.5309649,
    Spacing=150,
    LinkAngle=90,
    CotTheta=1.5,
    LeverFactor=0.9,
    Aggregate=20,
    AxialEccentricity=0)
topt = TorsionOptions(
    EnclosedArea=80000,
    MidlinePerimeter=1200,
    EffectiveThickness=100,
    LinkSteel=rs,
    LongitudinalSteel=rs,
    OneLegArea=50.26548246,
    Spacing=150,
    TorsionLongitudinalArea=800,
    CotTheta=1.5,
    HollowBothFacesReinforced=False,
    ClosedLinksAndDistributedBarsConfirmed=True)
cco = ConcreteCheckerOptions(
    CoordinateSystem=cs,
    FailureDomainTypes=1,
    FailureAnalysisTypes=0,
    DomainPointStrategyTypes=0,
    StressAnalysisTypes=1,
    ΨRebar=1.5,
    ΨTendon=0,
    ConsiderTensileConcrete=False,
    ThetaDiscretization=64)
fc = ForceComponent(Name="SLU-TV", AxialForce=-300, ShearX=20, ShearY=30, Torsion=5, BendingX=45, BendingY=15, CoordinateSystem=cs, Units=1)
cc = ConcreteChecker(ReinforcedConcreteSection=rectrc.RCSection, Standard=S, Options=cco)
tv = TorsionAndShear(Checker=cc, Force=fc, TorsionOptions=topt, ShearXOptions=vopt, ShearYOptions=vopt_2, SectionID="S")
report = CheckReport(Results=tv)  # -> CSV, JSON, Summary
result = CheckResult(Result=tv)  # -> Section, Case, Check, Status, Utilization, Demand, Capacity, Unit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
csv_risultati = Panel(report.CSV)
