# Grasshopper definition definition.ghx (Grasshopper 1.0.8)
# plug-ins: ReBear
# Esempio ReBear; leggere README.md.

# ReBear — esempio svolto: Resistenza N-Mx-My e inviluppo degli esiti
# Geometria: mm; forze: kN; momenti: kNm; compressione negativa.
# Dati a sinistra, verifiche e risultati verso destra.
# Dati persistenti nelle porte: tasto destro > Set...
# Consultare README.md e results.json nella stessa cartella.
# Run=True nei componenti di analisi predisposti.
dcm = DatabaseConcrete(Type=3)
rs = DatabaseRebarSteel(Type=1, Behaviour=0)
S = Standard(Type=0)
cs = CoordinateSystem(Name="Global XY", Origin=Point(0, 0, 0), P1=Point(1, 0, 0), P2=Point(0, 1, 0))
rectrc = RectangularRCSection(
    Concrete=dcm,
    Steel=rs,
    Width=300,
    Height=500,
    LinkCover=30,
    LinkDiameter=8,
    BarDiameter=20,
    TopBars=4,
    BottomBars=4,
    SideBarsPerFace=0)  # -> RCSection, ConcretePreview, Rebars, ConcreteArea, SteelArea, MinimumBarCover
cco = ConcreteCheckerOptions(
    CoordinateSystem=cs,
    FailureDomainTypes=1,
    FailureAnalysisTypes=0,
    DomainPointStrategyTypes=0,
    StressAnalysisTypes=1,
    ΨRebar=1.5,
    ΨTendon=0,
    ConsiderTensileConcrete=False,
    ThetaDiscretization=64)
fc = ForceComponent(
    Name="SLU-moderato",
    AxialForce=-300,
    ShearX=0,
    ShearY=0,
    Torsion=0,
    BendingX=80,
    BendingY=10,
    CoordinateSystem=cs,
    Units=1)
fc_2 = ForceComponent(
    Name="SLU-elevato",
    AxialForce=-300,
    ShearX=0,
    ShearY=0,
    Torsion=0,
    BendingX=400,
    BendingY=0,
    CoordinateSystem=cs,
    Units=1)
fc_3 = ForceComponent(
    Name="Fuori-dominio",
    AxialForce=-10000000,
    ShearX=0,
    ShearY=0,
    Torsion=0,
    BendingX=80,
    BendingY=0,
    CoordinateSystem=cs,
    Units=1)
cc = ConcreteChecker(ReinforcedConcreteSection=rectrc.RCSection, Standard=S, Options=cco)
batch = BatchSectionChecks(Checker=cc, Forces=[fc, fc_2, fc_3], SectionID="S", NMxMy=True, Run=True)  # -> Results, CSV, Envelope
checkenv = CheckEnvelope(Results=batch.Results)  # -> Group, Status, Governing, Pending, Count
report = CheckReport(Results=batch.Results)  # -> CSV, JSON, Summary
result = CheckResult(Result=batch.Results)  # -> Section, Case, Check, Status, Utilization, Demand, Capacity, Unit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
csv_risultati = Panel(report.CSV)
