# Grasshopper definition definition.ghx (Grasshopper 1.0.8)
# plug-ins: ReBear
# Esempio ReBear; leggere README.md.

# ReBear — esempio svolto: Fessurazione e regioni efficaci
# Geometria: mm; forze: kN; momenti: kNm; compressione negativa.
# Dati a sinistra, verifiche e risultati verso destra.
# Dati persistenti nelle porte: tasto destro > Set...
# Consultare README.md e results.json nella stessa cartella.
# Run=True nei componenti di analisi predisposti.
dcm = DatabaseConcrete(Type=3)
rs = DatabaseRebarSteel(Type=1, Behaviour=0)
S = Standard(Type=0)
sleopt = SLEOptions(
    Combination=0,
    Exposure="XC4",
    SensitiveReinforcement=False,
    ShortTerm=False,
    RibbedBars=True,
    LongitudinalBarCover=38,
    ConcentricRings=False)  # -> Options, ExposureCatalogue
cs = CoordinateSystem(Name="Global XY", Origin=Point(0, 0, 0), P1=Point(1, 0, 0), P2=Point(0, 1, 0))
rectrc = RectangularRCSection(
    Concrete=dcm,
    Steel=rs,
    Width=300,
    Height=500,
    LinkCover=30,
    LinkDiameter=8,
    BarDiameter=20,
    TopBars=4,
    BottomBars=4,
    SideBarsPerFace=0)  # -> RCSection, ConcretePreview, Rebars, ConcreteArea, SteelArea, MinimumBarCover
cco = ConcreteCheckerOptions(
    CoordinateSystem=cs,
    FailureDomainTypes=1,
    FailureAnalysisTypes=0,
    DomainPointStrategyTypes=0,
    StressAnalysisTypes=1,
    ΨRebar=1.5,
    ΨTendon=0,
    ConsiderTensileConcrete=False,
    ThetaDiscretization=64)
fc = ForceComponent(Name="SLE-QP", AxialForce=-100, ShearX=0, ShearY=0, Torsion=0, BendingX=100, BendingY=0, CoordinateSystem=cs, Units=1)
cc = ConcreteChecker(ReinforcedConcreteSection=rectrc.RCSection, Standard=S, Options=cco)
sa = StressAnalysis(ConcreteChecker=cc, Forces=fc)  # -> StressAnalysisResults, StrainPlaneResults
sle = ServiceabilityCheck(StressResult=sa.StressAnalysisResults, Options=sleopt.Options, SectionID="S")  # -> Results, CrackData
report = CheckReport(Results=sle.Results)  # -> CSV, JSON, Summary
result = CheckResult(Result=sle.Results)  # -> Section, Case, Check, Status, Utilization, Demand, Capacity, Unit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
aceff = EffectiveCrackedSection(CrackData=sle.CrackData)  # -> Regions, EffectiveConcreteArea, EffectiveSteelArea, CrackWidth, RegionsPreview, BarIndices
csv_risultati = Panel(report.CSV)
