# Grasshopper definition definition.ghx (Grasshopper 1.0.8)
# plug-ins: ReBear
# Esempio ReBear; leggere README.md.

dcm = DatabaseConcrete(Type=3)
S = Standard(Type=1)
# ReBear — esempio svolto: Copriferro per esposizioni concorrenti
# Geometria: mm; forze: kN; momenti: kNm; compressione negativa.
# Dati a sinistra, verifiche e risultati verso destra.
# Dati persistenti nelle porte: tasto destro > Set...
# Consultare README.md e results.json nella stessa cartella.
# Run=True nei componenti di analisi predisposti.
cover = ConcreteCover(
    Standard=S,
    Concrete=dcm,
    Exposures=["XC4", "XD1"],
    SpecificationBarDiameter=20,
    ActualBarDiameter=20,
    AdoptedCover=40,
    DesignLife=50,
    Deviation=10,
    Aggregate=20,
    SlabGeometryEN=False,
    SpecialQualityControlEN=False,
    StrengthClassReductionEN=False,
    PlateElementNTC=False,
    QualityControlReductionNTC=False,
    RoughSurface=False,
    Abrasion=0,
    Ground=0,
    SectionID="S")  # -> Result, RequiredNominal, DurabilityMinimum, CoverData
report = CheckReport(Results=cover.Result)  # -> CSV, JSON, Summary
result = CheckResult(Result=cover.Result)  # -> Section, Case, Check, Status, Utilization, Demand, Capacity, Unit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
csv_risultati = Panel(report.CSV)
