# Grasshopper definition definition.ghx (Grasshopper 1.0.8)
# plug-ins: ReBear
# Esempio ReBear; leggere README.md.

dcm = DatabaseConcrete(Type=3)
rs = DatabaseRebarSteel(Type=1, Behaviour=0)
S = Standard(Type=1)
# ReBear — esempio svolto: Ancoraggio e sovrapposizione di barre tese
# Geometria: mm; forze: kN; momenti: kNm; compressione negativa.
# Dati a sinistra, verifiche e risultati verso destra.
# Dati persistenti nelle porte: tasto destro > Set...
# Consultare README.md e results.json nella stessa cartella.
# Run=True nei componenti di analisi predisposti.
anchor = AnchorageAndLap(
    Standard=S,
    Concrete=dcm,
    Steel=rs,
    Diameter=20,
    DesignStress=300,
    AvailableLength=1000,
    GoodBond=True,
    Lap=False,
    LappedPercentage=100,
    LapClearDistance=20,
    SectionID="S")  # -> Result, RequiredLength, BondStrength
anchor_2 = AnchorageAndLap(
    Standard=S,
    Concrete=dcm,
    Steel=rs,
    Diameter=20,
    DesignStress=300,
    AvailableLength=1000,
    GoodBond=True,
    Lap=True,
    LappedPercentage=100,
    LapClearDistance=20,
    SectionID="S")  # -> Result, RequiredLength, BondStrength
report = CheckReport(Results=anchor.Result)  # -> CSV, JSON, Summary
result = CheckResult(Result=anchor.Result)  # -> Section, Case, Check, Status, Utilization, Demand, Capacity, Unit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
report_2 = CheckReport(Results=anchor_2.Result)  # -> CSV, JSON, Summary
result_2 = CheckResult(Result=anchor_2.Result)  # -> Section, Case, Check, Status, Utilization, Demand, Capacity, Unit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
csv_risultati = Panel(report.CSV)
csv_risultati_2 = Panel(report_2.CSV)
