# Grasshopper definition definition.ghx (Grasshopper 1.0.8)
# plug-ins: ReBear
# Esempio ReBear; leggere README.md.

# ReBear — esempio svolto: Soletta: armatura principale e secondaria
# Geometria: mm; forze: kN; momenti: kNm; compressione negativa.
# Dati a sinistra, verifiche e risultati verso destra.
# Dati persistenti nelle porte: tasto destro > Set...
# Consultare README.md e results.json nella stessa cartella.
# Run=True nei componenti di analisi predisposti.
dcm = DatabaseConcrete(Type=3)
rs = DatabaseRebarSteel(Type=1, Behaviour=0)
S = Standard(Type=0)
cs = CoordinateSystem(Name="Global XY", Origin=Point(0, 0, 0), P1=Point(1, 0, 0), P2=Point(0, 1, 0))
plateopt = PlateDetailingOptions(SecondarySteel=500, SecondarySpacing=200, CriticalRegion=False)
rectrc = RectangularRCSection(
    Concrete=dcm,
    Steel=rs,
    Width=1000,
    Height=250,
    LinkCover=30,
    LinkDiameter=0,
    BarDiameter=12,
    TopBars=6,
    BottomBars=6,
    SideBarsPerFace=0)  # -> RCSection, ConcretePreview, Rebars, ConcreteArea, SteelArea, MinimumBarCover
cco = ConcreteCheckerOptions(
    CoordinateSystem=cs,
    FailureDomainTypes=1,
    FailureAnalysisTypes=0,
    DomainPointStrategyTypes=0,
    StressAnalysisTypes=1,
    ΨRebar=1.5,
    ΨTendon=0,
    ConsiderTensileConcrete=False,
    ThetaDiscretization=64)
detopt = DetailingOptions(
    MemberKind=2,
    TopTensionWidth=1000,
    BottomTensionWidth=1000,
    WebWidth=1000,
    LinkDiameter=0,
    LinkSpacing=0,
    LinkLegs=0,
    NominalCover=30,
    Aggregate=20,
    CoverDeviation=10,
    DurabilityMinimum=20,
    LapZone=False,
    CompressionBarsRestrained=True,
    EndZonesConfirmed=True,
    PlateData=plateopt)
cc = ConcreteChecker(ReinforcedConcreteSection=rectrc.RCSection, Standard=S, Options=cco)
detail = ReinforcementDetailing(Checker=cc, Options=detopt, MinimumAxialForce=0, SectionID="S")  # -> Results, CSV
report = CheckReport(Results=detail.Results)  # -> CSV, JSON, Summary
result = CheckResult(Result=detail.Results)  # -> Section, Case, Check, Status, Utilization, Demand, Capacity, Unit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
csv_risultati = Panel(report.CSV)
