# Grasshopper definition definition.ghx (Grasshopper 1.0.8)
# plug-ins: ReBear
# Esempio ReBear; leggere README.md.

S = Standard(Type=0)
cs = CoordinateSystem(Name="Global XY", Origin=Point(0, 0, 0), P1=Point(1, 0, 0), P2=Point(0, 1, 0))
dcm = DatabaseConcrete(Type=3)
rs = DatabaseRebarSteel(Type=1, Behaviour=0)
# ReBear — esempio svolto: Scelta della minima armatura fra tre candidati
# Geometria: mm; forze: kN; momenti: kNm; compressione negativa.
# Dati a sinistra, verifiche e risultati verso destra.
# Dati persistenti nelle porte: tasto destro > Set...
# Consultare README.md e results.json nella stessa cartella.
# Run=True nei componenti di analisi predisposti.
fc = ForceComponent(Name="SLU1", AxialForce=-300, ShearX=0, ShearY=0, Torsion=0, BendingX=180, BendingY=5, CoordinateSystem=cs, Units=1)
fc_2 = ForceComponent(Name="SLU2", AxialForce=-200, ShearX=0, ShearY=0, Torsion=0, BendingX=150, BendingY=10, CoordinateSystem=cs, Units=1)
rectrc = RectangularRCSection(
    Concrete=dcm,
    Steel=rs,
    Width=300,
    Height=500,
    LinkCover=30,
    LinkDiameter=8,
    BarDiameter=16,
    TopBars=4,
    BottomBars=4,
    SideBarsPerFace=0)  # -> RCSection, ConcretePreview, Rebars, ConcreteArea, SteelArea, MinimumBarCover
cco = ConcreteCheckerOptions(
    CoordinateSystem=cs,
    FailureDomainTypes=1,
    FailureAnalysisTypes=0,
    DomainPointStrategyTypes=0,
    StressAnalysisTypes=1,
    ΨRebar=1.5,
    ΨTendon=0,
    ConsiderTensileConcrete=False,
    ThetaDiscretization=64)
rectrc_2 = RectangularRCSection(
    Concrete=dcm,
    Steel=rs,
    Width=300,
    Height=500,
    LinkCover=30,
    LinkDiameter=8,
    BarDiameter=20,
    TopBars=4,
    BottomBars=4,
    SideBarsPerFace=0)  # -> RCSection, ConcretePreview, Rebars, ConcreteArea, SteelArea, MinimumBarCover
rectrc_3 = RectangularRCSection(
    Concrete=dcm,
    Steel=rs,
    Width=300,
    Height=500,
    LinkCover=30,
    LinkDiameter=8,
    BarDiameter=24,
    TopBars=4,
    BottomBars=4,
    SideBarsPerFace=0)  # -> RCSection, ConcretePreview, Rebars, ConcreteArea, SteelArea, MinimumBarCover
cc = ConcreteChecker(ReinforcedConcreteSection=rectrc.RCSection, Standard=S, Options=cco)
cc_2 = ConcreteChecker(ReinforcedConcreteSection=rectrc_2.RCSection, Standard=S, Options=cco)
cc_3 = ConcreteChecker(ReinforcedConcreteSection=rectrc_3.RCSection, Standard=S, Options=cco)
assearch = ReinforcementCandidateSearch(CandidateCheckers=[cc, cc_2, cc_3], Forces=[fc, fc_2], TargetUtilization=0.9, Run=True)  # -> SelectedIndex, SelectedChecker, AllResults, SelectedSteelArea
report = CheckReport(Results=assearch.AllResults)  # -> CSV, JSON, Summary
result = CheckResult(Result=assearch.AllResults)  # -> Section, Case, Check, Status, Utilization, Demand, Capacity, Unit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
csv_risultati = Panel(report.CSV)
